# Grasshopper definition Code.gh (Grasshopper 1.0.7)
# plug-ins: LadybugGrasshopper

# ----
# Material
mesh = Mesh(<mesh referenced from the Rhino model>)
mesh_2 = Mesh(<mesh referenced from the Rhino model>)
mesh_3 = Mesh(<mesh referenced from the Rhino model>)
mesh_4 = Mesh([<mesh referenced from the Rhino model> x18])
mjoin = MeshJoin(Meshes=mesh)
mjoin_2 = MeshJoin(Meshes=mesh_2)
mjoin_3 = MeshJoin(Meshes=mesh_3)
mjoin_4 = MeshJoin(Meshes=mesh_4)
python = GhPythonScript(mesh=mjoin, name="Panel", size="0.1", sample="2", refract="2.17", metalic="9")  # -> material; inputs mesh: Mesh, sample: Int32
# ---------- python: Python ----------
import Rhino.Geometry as rg
from math import cos

class Material:
    #---/Private methods/---
    def __init__(self, mesh, txt, num1, num2, num3, num4):
        self.mesh = mesh
        self.tag = txt
        self.size = num1
        self.sample = num2
        self._refract = num3
        self._metalic = num4
    
    def __repr__(self):
        return 'Material_object<%s>' % self.tag
    
    #---/Public function methods/---
    def reflect(self, ang_inci):
        """Calculate metal reflectivity according to angle"""
        #---///Prepare the parts///---
        n_1 = 1
        n_2 = self._refract
        k_2 = self._metalic
        t1 = n_2 * n_2 + k_2 * k_2
        t2 = 2 * n_2 * cos(ang_inci)
        t3 = cos(ang_inci) * cos(ang_inci)
    
        #---///Calculate Reflectance///---
        Rs = (t1 - t2 + t3) / (t1 + t2 + t3)
        Rp = (t1 * t3 - t2 + 1) / (t1 * t3 + t2 + 1)
        reflect = 0.5 * (Rs + Rp)
        refract = 0
        return reflect, refract

material = Material(mesh, name, size, sample, refract, metalic)
# ---------- end python ----------
python_2 = GhPythonScript(mesh=mjoin_2, name="Skylight", size="0.1", sample="1", refract="2.07")  # -> material; inputs mesh: Mesh, sample: Int32
# ---------- python_2: Python ----------
import Rhino.Geometry as rg
from math import sin, tan, asin

class Material:
    #---/Private methods/---
    def __init__(self, mesh, txt, num1, num2, num3):
        self.mesh = mesh
        self.tag = txt
        self.size = num1
        self.sample = num2
        self._refract = num3
    
    def __repr__(self):
        return 'Material_object<%s>' % self.tag
    
    #---/Public function methods/---
    def reflect(self, ang_inci):
        """Calculate glass reflectivity according to angle"""
        n_1 = 1
        n_2 = self._refract
        if ang_inci == 0:
            R = pow((n_1 - n_2) / (n_1 + n_2), 2)
        else:
            ang_refr = asin(n_1 / n_2 * sin(ang_inci))
            r_norm = pow(sin(ang_inci - ang_refr) / sin(ang_inci + ang_refr), 2)
            r_para = pow(tan(ang_inci - ang_refr) / tan(ang_inci + ang_refr), 2)
            R = 0.5 * (r_norm + r_para)
        reflect = 2 * R / (1 + R)
        refract = abs(-0.0084 * ang_inci * ang_inci * ang_inci -
                      0.0757 * ang_inci * ang_inci + 0.0203 * ang_inci + 0.1853)
        return reflect, refract

material = Material(mesh, name, size, sample, refract)
# ---------- end python_2 ----------
python_3 = GhPythonScript(material=python_2)  # -> Reflects, Refracts
# ---------- python_3: Python ----------
__author__ = "ccy"
__version__ = "2022.11.16"

from math import radians

Angs = []
for i in range(91):
    Angs.append(radians(i))

Reflects = []
Refracts = []
for ang in Angs:
    [refl, refr] = material.reflect(ang)
    Reflects.append(refl)
    Refracts.append(refr)
# ---------- end python_3 ----------
python_4 = GhPythonScript(mesh=mjoin_3, name="Ground", size="0.1", sample="1")  # -> material; inputs mesh: Mesh, sample: Int32
# ---------- python_4: Python ----------
import Rhino.Geometry as rg

class Material:
    #---/Private methods/---
    def __init__(self, mesh, txt, num1, num2):
        self.mesh = mesh
        self.tag = txt
        self.size = num1
        self.sample = num2
    
    def __repr__(self):
        return 'Material_object<%s>' % self.tag
    
    #---/Public function methods/---
    def reflect(self, ang_inci):
        return 0, 0

material = Material(mesh, name, size, sample)
# ---------- end python_4 ----------
graph = QuickGraph([python_3.Reflects, python_3.Refracts], SortOrder=0)
python_5 = GhPythonScript(mesh=mjoin_4, name="Air", size="0.1")  # -> air; inputs mesh: Mesh
# ---------- python_5: Python ----------
import Rhino.Geometry as rg

class Air:
    #---/Private methods/---
    def __init__(self, mesh, txt, num):
        self.mesh = mesh
        self.tag = txt
        self.size = num
        self.sample = 0
    
    def __repr__(self):
        return 'Air_object<%s>' % self.tag

air = Air(mesh, name, size)
# ---------- end python_5 ----------
merge = Merge(Data1=python, Data2=python_2, Data3=python_4, Data4=python_5)

# ----
# Scene
falsestart = LBFalseStartToggle(True)
falsestart_2 = LBFalseStartToggle(False)
python_6 = GhPythonScript(Materials=merge, gen_it=falsestart)  # -> Scenes, Checks; inputs Materials: list, gen_it: Boolean
# ---------- python_6: Python ----------
import Rhino.Geometry as rg
import scriptcontext as sc
from math import cos
import ghpythonlib.parallel

#----------///The class definitions///----------
class Scene:
    #---/Private methods/---
    def __init__(self, txt):
        self._archive = {}
        self._library = {}
        self._tag = txt
    
    def __repr__(self):
        return 'scene_object<%s>' % self._tag
    
    #---/Public function methods/---
    def calc_reflection(self, tag, ang_inci):
        [reflect, refract] = self._library[tag].reflect(ang_inci)
        return reflect, refract
    
    #---/Public getters/---
    def get_Panels(self):
        return self._archive.values()
    
    def get_panel(self, idx): #Used in sync_panel for ray
        return self._archive[idx]
    
    def get_mesh(self):
        return self._mesh
    
    #---/Public setters/---
    def add_mesh(self, mesh):
        self._mesh = mesh
    
    def init_panel(self, idx_panel, obj_panel):
        self._archive[idx_panel] = obj_panel
    
    def add_material(self, tag, obj_material):
        self._library[tag] = obj_material

class Panel:
    #---/Private methods/---
    def __init__(self, idx, tag, size, sample):
        self._idx = idx
        self._tag = tag
        self.size = size
        self._sample = sample
        if self._sample:
            length_sample = self.size / self._sample
            self._area_sample = length_sample * length_sample
        else:
            self._area_sample = 0
    
    def __repr__(self):
        return '%s_object_<%s>' % (self._tag, self._idx)
    
    #---/Private function methods/---
    
    #---/Public function methods/---
    def prepare(self, scene):
        #-/Generate new mesh from face/-
        mesh = _get_face_mesh(scene.get_mesh(), self._idx)
        
        #-/Get basic information/-
        self._vect = mesh.NormalAt(0, 0.5, 0, 0.5, 0)
        self._pt = mesh.PointAt(0, 0.5, 0, 0.5, 0)
        
        if self._sample:
            #-/Get on-plane boundingbox of mesh/-
            pt_targ = ((mesh.PointAt(0, 1, 0, 0, 0) +
                        mesh.PointAt(0, 0, 1, 0, 0)) / 2)
            pln = get_pln(self._pt, self._vect, pt_targ)
            bbox = mesh.GetBoundingBox(pln)
            if bbox.IsDegenerate(TOL) == 1:
                #-/Generate 2D box with good bounding box/-
                box = rg.Box(bbox)
            else:
                #-/Generate again/-
                mesh_flat = mesh.Duplicate()
                smash = rg.Transform.ProjectAlong(pln, pln.ZAxis)
                mesh_flat.Transform(smash)
                bbox = mesh_flat.GetBoundingBox(pln)
                if bbox.IsDegenerate(TOL) != 1:
                    Checks.append(self._pt)
                    #raise Exception('The quad mesh is not flat!')
                box = rg.Box(bbox)
            
            #-/Generate plane mesh with spacing/-
            mesh_box = rg.Mesh.CreateFromPlane(rg.Plane.WorldXY,
                       box.X, box.Y, self._sample, self._sample)
            trans1 = rg.Transform.PlaneToPlane(rg.Plane.WorldXY, pln)
            trans2 = rg.Transform.Translation(self._vect)
            mesh_box.Transform(trans1)
            mesh_box.Transform(trans2)
            
            #-/use mesh ray to filter the on-mesh points/-
            Pts = []
            for idx in range(mesh_box.Faces.Count):
                pt = mesh_box.PointAt(idx, 0.5, 0, 0.5, 0)
                Pts.append(pt)
            self._Pts = []
            for pt in Pts:
                ray = rg.Ray3d(pt, -self._vect)
                dist = rg.Intersect.Intersection.MeshRay(mesh, ray)
                if dist >= 0:
                    self._Pts.append(pt - self._vect)
        else:
            self._Pts = []
    
    def is_sunlit(self, vect_in):
        if self._Pts and self._vect * vect_in < 0:
            return True
        else:
            return False
    
    def refresh(self):
        self._factor = 0
    
    def calc_area_lumen(self, vect_sun_earth):
        pln = rg.Plane(self._pt, -vect_sun_earth, self._vect)
        inci = rg.Vector3d.VectorAngle(-vect_sun_earth, self._vect, pln)
        area_out = self._area_sample * cos(inci)
        return area_out
    
    def add_factor(self, num):
        self._factor += num
    
    #---/Public getters/---
    def get_Pts(self):
        return self._Pts
    
    def get_norm(self):
        return self._vect
    
    def get_idx(self):
        return self._idx
    
    def get_tag(self):
        return self._tag
    
    def get_factor(self):
        return self._factor

#----------///The function definitions///----------
def init_scene(Objs, txt):
    #---/Initiate the scene object/---
    scene = Scene(txt)
    idx_panel = 0
    mesh_all = rg.Mesh()
    
    #---/Iterate meshes & initiate the panel objects/---
    for material in Objs:
        mesh = material.mesh
        tag = material.tag
        size = material.size
        sample = material.sample
        scene.add_material(tag, material)
        for idx_face in range(mesh.Faces.Count):
            panel = Panel(idx_panel, tag, size, sample)
            scene.init_panel(idx_panel, panel)
            idx_panel += 1
        mesh_all.Append(mesh)
    scene.add_mesh(mesh_all)
    
    return scene

def _get_face_mesh(mesh, idx):
    #-/Get components from the old mesh/-
    face = mesh.Faces[idx]
    ptA = mesh.Vertices[face.A]
    ptB = mesh.Vertices[face.B]
    ptC = mesh.Vertices[face.C]
    ptD = mesh.Vertices[face.D]
    
    #-/Construct the new mesh/-
    mesh_new = rg.Mesh()
    mesh_new.Vertices.Add(ptA)
    mesh_new.Vertices.Add(ptB)
    mesh_new.Vertices.Add(ptC)
    mesh_new.Vertices.Add(ptD)
    mesh_new.Faces.AddFace(0, 1, 2, 3)
    mesh_new.Normals.ComputeNormals()
    mesh_new.Compact()
    return mesh_new

def get_pln(pto, vect_z, ptx):
    pln = rg.Plane(pto, vect_z)
    vect_x = rg.Vector3d(ptx - pto)
    vect_x.Unitize()
    ang = rg.Vector3d.VectorAngle(pln.XAxis, vect_x, pln)
    pln.Rotate(ang, pln.Normal, pln.Origin)
    return pln

def prepare_solid(panel):
    panel.prepare(scene_solid)

def prepare_air(panel):
    panel.prepare(scene_air)

if gen_it:
    #---/Get the system accuracy (normally 0.001)/---
    TOL = sc.doc.ModelAbsoluteTolerance
    Checks = []
    
    #---/Sperate materials and generate solid & air scenes/---
    Solids = []
    Airs = []
    for material in Materials:
        tag = material.tag
        if tag == 'Air' or tag == 'air':
            Airs.append(material)
        else:
            Solids.append(material)
    
    #---/Iterate dictionary keys parallely and prepare panels/---
    scene_solid = init_scene(Solids, 'Solid')
    ghpythonlib.parallel.run(prepare_solid, scene_solid.get_Panels(), False)
    Scenes = [scene_solid]
    if Airs:
        scene_air = init_scene(Airs, 'Air')
        ghpythonlib.parallel.run(prepare_air, scene_air.get_Panels(), False)
        Scenes.append(scene_air)
# ---------- end python_6 ----------
python_7 = GhPythonScript(scene=python_6.Scenes, show_it=falsestart_2)  # -> Pts_all; inputs show_it: Boolean
# ---------- python_7: Python ----------
__author__ = "ccy"
__version__ = "2022.11.04"

if show_it:
    Pts_all = []
    for panel in scene.get_Panels():
        Pts = panel.get_Pts()
        if not Pts:
            print(1)
        Pts_all.extend(Pts)
# ---------- end python_7 ----------

# ----
# Post Analysis
panel = Panel("Annual_Index")
colrange = LBColorRange(index="3")  # -> colors; plug-in component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
falsestart_3 = LBFalseStartToggle(True)
python_8 = GhPythonScript(folder="Results", name=panel)  # -> path
# ---------- python_8: Python ----------
import os
import Rhino.RhinoDoc as rrd

#---///Prepare the folder path part///---
path_3dm = rrd.ActiveDoc.Path
path_folder = os.path.dirname(os.path.abspath(path_3dm))
path_folder += "\\" + folder + "\\"


#---///Get the whole path///---
path = path_folder + name + '.txt'
# ---------- end python_8 ----------
item = ListItem(List=python_6.Scenes, Index=0, Wrap=True)  # -> Item, Item1
legendpar = LBLegendParameters(
    min="0",
    max="2500",
    seg_count="6",
    colors=colrange,
    continuous_leg=Toggle(True),
    num_decimals="0",
    seg_height="30",
    seg_width="8",
    text_height="4")  # -> leg_par; plug-in component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
python_9 = GhPythonScript(scene=item.Item, path=python_8, Bool=falsestart_3)  # -> Energies, mesh, pack_keep, pack_remove; inputs Bool: Boolean
# ---------- python_9: Python ----------
#----------///The class definitions///----------
class Package:
    #---/Private methods/---
    def __init__(self):
        self._Lst = []
    
    def __repr__(self):
        return 'scene_object<%s>' % str(len(self._Lst))
    
    #---/Public methods/---
    def add(self, num):
        self._Lst.append(num)
    
    def get(self):
        return self._Lst

if path and Bool:
    mesh = scene.get_mesh()
    Energies = []
    pack_keep = Package()
    pack_remove = Package()
    with open(path, 'r') as file:
        for idx, txt in enumerate(file):
            Lst_info = txt.split(';')
            energy = float(Lst_info.pop(0))
            Energies.append(energy)
            if Lst_info:
                pack_keep.add(idx)
            else:
                pack_remove.add(idx)
# ---------- end python_9 ----------
falsestart_4 = LBFalseStartToggle(False)
falsestart_5 = LBFalseStartToggle(True)
python_10 = GhPythonScript(folder="Results", name="Annual_Index_Air")  # -> path; same code as python_8
python_11 = GhPythonScript(
    scene=item.Item,
    tag="Ground_0.5",
    path=python_8,
    pack_keep=python_9.pack_keep,
    pack_remove=python_9.pack_remove,
    run_it=falsestart_4)  # -> archive, Timestamps, pack_keep_new, pack_remove_new
# ---------- python_11: Python ----------
#----------///The class definitions///----------
class Archive:
    #---/Private methods/---
    def __init__(self):
        self._dict = {}
    
    def __repr__(self):
        return 'archive_object<%s>' % str(len(self._dict.keys()))
    
    #---/Public methods/---
    def add(self, idx, timestamp):
        if timestamp in self._dict.keys():
            self._dict[timestamp].append(idx)
        else:
            self._dict[timestamp] = [idx]
    
    def get_Idcs(self, timestamp):
        Lst_idx = self._dict[timestamp]
        return Lst_idx
    
    def get_times(self):
        Lst_time = self._dict.keys()
        Lst_value = []
        for timestamp in Lst_time:
            Lst_txt = timestamp.split('_')
            mm = float(Lst_txt[0])
            dd = float(Lst_txt[1]) * 0.01
            hh = float(Lst_txt[2]) * 0.0001
            mimi = float(Lst_txt[3]) * 0.000001
            num = mm + dd + hh + mimi
            Lst_value.append(num)
        Lst_time_sort = list(time for value, time in sorted(zip(Lst_value, Lst_time)))
        return Lst_time_sort

class Package:
    #---/Private methods/---
    def __init__(self):
        self._Lst = []
    
    def __repr__(self):
        return 'scene_object<%s>' % str(len(self._Lst))
    
    #---/Public methods/---
    def add(self, num):
        self._Lst.append(num)
    
    def get(self):
        return self._Lst

#----------///Main///----------
if run_it:
    #-/Update the indices/-
    pack_remove_new = Package()
    for idx in pack_remove.get():
        pack_remove_new.add(idx)
    pack_keep_new = Package()
    for idx in pack_keep.get():
        panel = scene.get_panel(idx)
        tag_test = panel.get_tag()
        if tag_test != tag:
            pack_remove_new.add(idx)
        else:
            pack_keep_new.add(idx)
    
    #-/Search the sensitive time in annual result/-
    archive = Archive()
    with open(path, 'r') as file:
        Lst_txt = file.readlines()
    for idx in pack_keep_new.get():
        txt = Lst_txt[idx]
        Lst_info = txt.split(';')
        energy = Lst_info.pop(0)
        for txt_info in Lst_info:
            timestamp = txt_info.split(' ')[0]
        if Lst_info:
            for txt_info in Lst_info:
                timestamp = txt_info.split(' ')[0]
                archive.add(idx, timestamp)
    Timestamps = archive.get_times()
# ---------- end python_11 ----------

# ----
# Solar
falsestart_6 = LBFalseStartToggle(False)
tau_b = Panel("""0.598
0.638
0.671
0.679
0.663
0.717
0.685
0.66
0.614
0.612
0.62
0.59""")
falsestart_7 = LBFalseStartToggle(True)
python_12 = GhPythonScript(start="2019", end="2023")  # -> Nums; inputs start: Int32, end: Int32
# ---------- python_12: Python ----------
__author__ = "ccy"
__version__ = "2022.09.02"

curr = start
Nums = []
for i in range(end - start + 1):
    Nums.append(curr)
    curr += 1
# ---------- end python_12 ----------
python_13 = GhPythonScript(start="5", end="7")  # -> Nums; inputs start: Int32, end: Int32; same code as python_12
python_14 = GhPythonScript(start="21", end="21", step="1")  # -> Nums; inputs start: Int32, end: Int32, step: Int32
# ---------- python_14: Python ----------
__author__ = "ccy"
__version__ = "2022.09.02"

from math import floor

curr = start
Nums = []
for i in range(int(floor((end - start + 1)/step))):
    Nums.append(curr)
    curr += step
# ---------- end python_14 ----------
python_15 = GhPythonScript(start="11", end="13", step="1")  # -> Nums; inputs start: Int32, end: Int32, step: Int32; same code as python_14
python_16 = GhPythonScript(start="30", end="30", step="1")  # -> Nums; inputs start: Int32, end: Int32, step: Int32; same code as python_14
mesh_5 = Mesh([<mesh referenced from the Rhino model> x2])  # disabled
tau_d = Panel("""1.664
1.611
1.574
1.616
1.681
1.619
1.715
1.75
1.816
1.739
1.677
1.692""")
mjoin_5 = MeshJoin(Meshes=mesh_5)  # disabled
ashrae_sunpath = ASHRAESunPath(
    Latitude="34.199",
    Longitude="108.8716",
    TimeZone="8",
    Year=python_12,
    Month=python_13,
    Day=python_14,
    Hour=python_15,
    Minute=python_16,
    Taus_b=tau_b,
    Taus_d=tau_d,
    gen_it=falsestart_7)  # -> out, Recipes; inputs TimeZone: Int32, Year: list of Int32, Month: list of Int32, Day: list of Int32, Hour: list of Int32, Minute: list of Int32, Taus_b: list, Taus_d: list, gen_it: Boolean
# ---------- ashrae_sunpath: Python ----------
"""Calculate the solar angles in target times.
    Inputs:
        Latitude: The latitude number of site in degree
        Longitude: The longitude number of site in degree
        TimeZone: The time zone number of site, 0 for London, 8 for Beijing
        Month: The target months, 1 to 12, single or multiple
        Day: The target days, single or multiple
        Hour:  The target hours, single or multiple
        Taus_b: The optical depths of beam light, average of month
        Taus_d: The optical depths of diffused light, average of month
    Output:
        Recipes: The recipes including datetime and solar information"""

__author__ = "ccy"
__version__ = "2021.11.04"

import Rhino.Geometry as rg
from math import sin, asin, cos, acos, radians, degrees, pi, exp, floor
from datetime import datetime, date

class Recipe:
    def __init__(self, mon, day, hr, min, alt, azi, vect, E_b, E_d):
        txt_mon = self._prepare(mon)
        txt_day = self._prepare(day)
        txt_hr = self._prepare(hr)
        txt_min = self._prepare(min)
        self.timestamp = txt_mon + '_' + txt_day + '_' + txt_hr + '_' + txt_min
        self.altitude = alt
        self.azimuth = azi
        self.sunvect = vect
        self.irr_beam = E_b
        self.irr_diff = E_d
    
    def __repr__(self):
        return 'Weather_object<%s>' % self.timestamp
    
    def _prepare(self, num):
        if num < 10:
            txt = '0' + str(num)
        else:
            txt = str(num)
        return txt

#----------///Public method definitions///----------
def get_annual_day(year, month, day):
    try:
        day_now = date(year, month, day)
        day_start = date(year, 1, 1)
        day_delta = day_now - day_start
        num = day_delta.days + 1
        return num
    except:
        return None

def get_declination(n, year):
    n_0 = 79.6764 + 0.2422 * (year - 1985) - floor((year - 1985) / 4)
    t = n - n_0
    theta = 2 * pi * t / 365.2422
    delta_degree = (0.3723 + 23.2567*sin(theta) + 0.1149*sin(2*theta) - 
                    0.1712*sin(3*theta) - 0.758*cos(theta) + 
                    0.3656*cos(2*theta) + 0.0201*cos(3*theta))
    delta = radians(delta_degree)
    return delta

def get_equation_time(n):
    Tau = radians(360 * (n - 1) / 365)
    ET = 2.2918 * (0.0075 + 0.1868*cos(Tau) - 3.2077*sin(Tau) -
         1.4615*cos(2*Tau) - 4.089*sin(2*Tau))
    return ET

def get_hour_angle(LST, LON, LSM, ET):
    AST = LST + ET/60 + (LON - LSM)/15
    H = radians(15 * (AST - 12))
    return H

def get_irradiance(alt, n, Tau_b, Tau_d):
    #Calculate the extraterrestrial radiant flux E0
    Esc = 1367
    E0 = Esc * (1 + 0.033*cos(radians(360*(n-3)/365)))
    
    #Calculate the air mass exponents
    ab = 1.454 - 0.406*Tau_b - 0.268*Tau_d + 0.021*Tau_b*Tau_d
    ad = 0.507 + 0.205*Tau_b - 0.080*Tau_d - 0.190*Tau_b*Tau_d
    
    #Calculate the air mass
    m = 1 / (sin(alt) + 0.50572*pow((6.07995+alt),-1.6364))
    
    #Calculate the beam normal irradiance
    E_b = E0 * exp(-Tau_b * pow(m, ab))
    E_d = E0 * exp(-Tau_d * pow(m, ad))
    return E_b, E_d

def get_solar_position(lat, declin, h, doy, tau_b, tau_d):
    lat = radians(lat)
    #---/Find the solar altitude angle in radians/---
    sin_alt = sin(lat) * sin(declin) + cos(lat) * cos(declin) * cos(h)
    alt_rad = asin(sin_alt)
    
    #---/Find the solar azimuth angle in radians/---
    sin_azi = cos(declin) * sin(h) / cos(alt_rad)
    cos_azi = ((cos(h) * cos(declin) * sin(lat) - sin(declin) * cos(lat)) /
             cos(alt_rad))
    sun_vect = rg.Vector3d(-sin_azi, -cos_azi, 0)
    azi_rad = rg.Vector3d.VectorAngle(-rg.Vector3d.YAxis, sun_vect,
                   rg.Plane(rg.Point3d.Origin, -rg.Vector3d.ZAxis))
    if azi_rad > pi:
        azi_rad -= pi * 2
    #---/treat the results/---
    pln_ref = rg.Plane(rg.Point3d.Origin, sun_vect, rg.Vector3d.ZAxis)
    sun_vect.Rotate(alt_rad, pln_ref.ZAxis)
    sun_vect.Unitize()
    sun_vect = -sun_vect
    alt_deg = degrees(alt_rad)
    azi_deg = degrees(azi_rad)
    
    #---/Get the clear sky irradiances/---
    if alt_rad > 0:
        [E_b, E_d] = get_irradiance(alt_rad, doy, tau_b, tau_d)
    else:
        [E_b, E_d] = 0, 0
    
    return alt_deg, azi_deg, sun_vect, E_b, E_d

def get_txt(mon, day, hr, min, alt, azi, vect):
    txt_mon = _treat_date(mon)
    txt_day = _treat_date(day)
    txt_hr = _treat_date(hr)
    txt_min = _treat_date(min)
    txt_timestamp = txt_mon + '/' + txt_day + '/' + txt_hr + '/' + txt_min
    Lst_num_vect = [str(vect.X), str(vect.Y), str(vect.Z)]
    txt_vect = ','.join(Lst_num_vect)
    txt_alt = str(round(alt, 2))
    txt_azi = str(round(azi, 2))
    txt = ('T' + txt_timestamp + '_ALT' + txt_alt + '_AZI' + txt_azi +
           '_V' +  txt_vect)
    return txt

#----------///Private method definitions///----------
def _treat_date(num):
    if num < 10:
        txt = '0' + str(num)
    else:
        txt = str(num)
    return txt

#----------///Main///----------
if gen_it:
    #---/Calculate constant values/---
    LSM = 15 * TimeZone
    
    #---/Iterate the months/---
    Recipes = []
    for mon in Month:
        tau_b = Taus_b[mon - 1]
        tau_d = Taus_d[mon - 1]
        #---/Iterate the days/---
        for day in Day:
            #---/Calculate the solar decilination angle at the day/---
            is_dd_valid = True
            Declins = []
            for year in Year:
                doy = get_annual_day(year, mon, day)
                if doy:
                    declin = get_declination(doy, year)
                    Declins.append(declin)
                else:
                    is_dd_valid = False
                    break
            if is_dd_valid:
                declin_mean = sum(Declins) / len(Declins)
                ET = get_equation_time(doy)
                #---/Iterate the hours/---
                for hour in Hour:
                    #---/Iterate the minute/---
                    for min in Minute:
                        hour_lst = hour + min/60
                        ang_hour = get_hour_angle(hour_lst, Longitude, LSM, ET)
                        [alt, azi, vect, E_b, E_d] = get_solar_position(
                                  Latitude, declin, ang_hour, doy, tau_b, tau_d)
                        if alt >= 10:
                            recipe = Recipe(mon, day, hour, min, alt, azi, vect,
                                            E_b, E_d)
                            Recipes.append(recipe)
# ---------- end ashrae_sunpath ----------
python_17 = GhPythonScript(Recipes=ashrae_sunpath.Recipes, Timestamps=python_11.Timestamps, run_it=falsestart_6)  # -> Recipes_out; inputs Recipes: list, Timestamps: list, run_it: Boolean
# ---------- python_17: Python ----------
import os
import Rhino.RhinoDoc as rrd
import ghpythonlib.parallel

#----------///The class definitions///----------
class Package:
    #---/Private methods/---
    def __init__(self):
        self._Lst = []
    
    def __repr__(self):
        return 'scene_object<%s>' % str(len(self._Lst))
    
    #---/Public methods/---
    def add(self, num):
        self._Lst.append(num)
    
    def get(self):
        return self._Lst

#----------///The function definitions///----------
def get_beginner(txt):
    idx_first = None
    txt_panel = txt.split('_')[-1]
    try:
        Lst_idx = txt_panel.split(',')
        for txt_idx in Lst_idx:
            idx_pass = int(txt_idx)
            if idx_pass in Idcs_panel:
                idx_first = int(Lst_idx[0])
                break
    except:
        pass
    return idx_first

if run_it:
    #-/Get the target receipe/-
    Recipes_out = []
    for recipe in Recipes:
        timestamp_test = recipe.timestamp
        if timestamp_test in Timestamps:
            Recipes_out.append(recipe)
# ---------- end python_17 ----------
python_18 = GhPythonScript(mesh=mjoin_5, Recipes=python_17)  # -> Suns, Crvs; inputs mesh: Mesh, Recipes: list; disabled
# ---------- python_18: Python ----------
__author__ = "ccy"
__version__ = "2022.01.01"

import Rhino.Geometry as rg

def add_to_dict(dict, mon, pt):
    if mon in dict.keys():
        dict[mon].append(pt)
    else:
        dict[mon] = [pt]
    return dict

if mesh and Recipes:
    bbox = mesh.GetBoundingBox(False)
    ptc = bbox.Center
    ptc = rg.Point3d(ptc.X, ptc.Y, 0)
    radius = bbox.Diagonal.Length / 2.5
    
    dict_Pts = {}
    Suns = []
    for recipe in Recipes:
        lst_timestamp = recipe.timestamp.split('_')
        date = lst_timestamp[0] + '_' + lst_timestamp[1]
        sunvect = recipe.sunvect
        pt = ptc - sunvect * radius
        dict_Pts = add_to_dict(dict_Pts, date, pt)
        sphere = rg.Sphere(pt, 5)
        Suns.append(sphere)
    Crvs = []
    for mon in dict_Pts.keys():
        lst_Pts = dict_Pts[mon]
        crv = rg.Arc(lst_Pts[0], lst_Pts[int(len(lst_Pts) / 2)], lst_Pts[-1])
        Crvs.append(crv)
# ---------- end python_18 ----------
swatch = ColourSwatch(SwatchColor=RGB(255, 217, 0))  # disabled
mesh_6 = MeshBrep(
    Brep=python_18.Suns,
    Settings={GridMaxCount=0, GridMinCount=16, JaggedSeams=False, MaxEdgeLength=0, MinEdgeLength=0.0001, MinTolerance=0, Refine=True, RefineAngle=0, RelativeTolerance=0.65, SimplePlanes=True, Tolerance=0})  # disabled
crv = Curve(python_18.Crvs)  # disabled
mcol = MeshColours(Mesh=mesh_6, Colours=swatch)  # disabled

# ----
# Analysis
number_slider = Slider(-1, range=-1..8)
python_19 = GhPythonScript(step=number_slider, Recipes=ashrae_sunpath.Recipes)  # -> Message, recipe; inputs step: Int32, Recipes: list
# ---------- python_19: Python ----------
if step >= 0:
    # Get the desired recipes
    recipe = Recipes[step]
    recipe_last = Recipes[-1]
    
    # Get the step and make comment on it
    step_max = len(Recipes) - 1
    step_left = step_max - step
    if step_left == 0:
        comment = "Finished! That's a loooooong day"
    elif step_left == step_max:
        comment = "Woo~ The journey starts......"
    elif step_left > step_max / 2:
        comment = "May Barbatos bless you......"
    else:
        comment = "Hold on! We are almost there!"
    
    irr_beam = "{:.1f}".format(recipe.irr_beam)
    irr_diff = "{:.1f}".format(recipe.irr_diff)
    
    # Display the message
    Message = """On step: {0}, maximum step: {1}, left {2} to go
    Current Time: {3}
    Maximum Time: {4}
    Current Beam Normal Irradiance: {5} W/m^2
    Current Diffuse Horizontal Irradiance: {6} W/m^2
    {7}""".format(step, step_max, step_left,
                  recipe.timestamp, recipe_last.timestamp,
                  irr_beam, irr_diff, comment)
# ---------- end python_19 ----------
panel_2 = Panel(python_19.Message)
python_20 = GhPythonScript(recipe=python_19.recipe)  # -> Paths
# ---------- python_20: Python ----------
import os
import Rhino.RhinoDoc as rrd

if recipe:
    #---///Prepare the folder path part///---
    path_3dm = rrd.ActiveDoc.Path
    folder = os.path.dirname(os.path.abspath(path_3dm))
    folder1 = folder + "\\Logs\\"
    folder2 = folder + "\\Results\\"
    
    #---///Prepare the timestemp part///---
    timestamp = recipe.timestamp
    lst = timestamp.split('_')
    
    #---///Get the whole path///---
    path1 = folder1 + 'Log_' + timestamp + '.txt'
    path2 = folder2 + 'Result_' + timestamp + '.txt'
    path3 = folder2 + 'ResultAir_' + timestamp + '.txt'
    Paths = [path1, path2, path3]
# ---------- end python_20 ----------
falsestart_8 = LBFalseStartToggle(False)
python_21 = GhPythonScript(recipe=python_19.recipe, Paths=python_20, Scenes=python_6.Scenes, run_it=falsestart_8)  # -> out; inputs Paths: list, Scenes: list, run_it: Boolean
# ---------- python_21: Python ----------
import Rhino.Geometry as rg
import scriptcontext as sc
from System import Array
import clr
import ghpythonlib.parallel

#----------///The class definitions///----------
class Ray:
    #---/Private methods/---
    def __init__(self, idx_panel1, Idcs_panel2,
                 pt_in, vect, trans, area, portion):
        pt = rg.Point3d(pt_in)
        pt.Transform(trans)
        self._Pts = [pt]
        self._Vects = [vect]
        self._area = area
        self._portion = [portion]
        if Idcs_panel2:
            self._status = 1 #The ray is already initiated
            self._tag = 'I_' + str(idx_panel1)
            self._Idcs_face = [Idcs_panel2]
        else:
            self._status = 0 #The ray is waiting to be initiated
            self._tag = 'O_' + str(idx_panel1)
            self._Idcs_face = []
        self._pool = []
    
    #---/Private function methods/---
    def _sync_panel(self, Lst, vect_ray):
        #-/Read information from the scene archive by indices/-
        valid = False
        vect = rg.Vector3d.Zero
        Lst_tag = []
        factor = self._portion[-1] * self._area
        for idx in Lst:
            panel = scene_solid.get_panel(idx)
            vect_panel = panel.get_norm()
            if vect_panel * vect_ray < 0:
                valid = True
                panel.add_factor(factor)
                vect += panel.get_norm()
                tag = panel.get_tag()
                if not tag in Lst_tag:
                    Lst_tag.append(tag)
        if valid:
            vect.Unitize()
            tag = Lst_tag[0]
            return vect, tag
        else:
            #-/Turn to the terminating routine/-
            self._status = -1 #Ray get lost
            return None, None
    
    def _sync_air(self, idx, portion):
        factor = portion * self._area
        panel = scene_air.get_panel(idx)
        panel.add_factor(factor)
    
    #---/Public function methods/---
    def forward(self, mesh):
        #-/Prepare the basic forward recipe/-
        adjust = TOL
        Idcs = clr.StrongBox[Array[int]]()
        Lst_idx = []
        pt = self._Pts[-1]
        vect = self._Vects[-1]
        pt_start = pt + vect * adjust
        
        #-/Initial forward to see if missed anything/-
        ray = rg.Ray3d(pt_start, -vect)
        dist = rg.Intersect.Intersection.MeshRay(mesh, ray, Idcs)
        Lst_check = list(Idcs.Value)
        if (dist > 0 and dist < vect.Length * adjust and
                       Lst_check != self._Idcs_face[-1]):
            #-/Really missed something/-
            pt_new = pt_start - vect * dist
            Lst_idx.extend(Lst_check)
        else:
            #-/Not missing anything/-
            ray = rg.Ray3d(pt_start, vect)
            dist = rg.Intersect.Intersection.MeshRay(mesh, ray, Idcs)
            if dist > 0:
                pt_new = pt_start + vect * dist
                Lst_idx.extend(list(Idcs.Value))
            else:
                #-/Turn to the terminating routine/-
                self._status = -1 #Ray get lost
                dist = 20
                pt_new = pt_start + vect * dist
        return pt_new, Lst_idx
    
    def reflect(self, mesh, pt, Lst_idx):
        if self._status == 1 or self._status == 0:
            #-/The ray is on going or is waiting to be initiated/-
            #-/Attract information from the panels/-
            [vect_norm, tag] = self._sync_panel(Lst_idx, self._Vects[-1])
            
            if self.is_valid():
                #-/Calculate the incident angle/-
                pln = rg.Plane(pt, vect_norm, -self._Vects[-1])
                rad = rg.Vector3d.VectorAngle(vect_norm, -self._Vects[-1], pln)
                [reflect, refract] = scene_solid.calc_reflection(tag, rad)
                
                #-/Prepare recipe for new refract ray/-
                if refract:
                    self._pool.append([pt, self._Vects[-1],
                                       self._portion[-1] * refract,
                                       Lst_idx])
                #-/Continue reflecting/-
                self._portion.append(self._portion[-1] * reflect)
            if self.is_valid():
                #-/Reflection/-
                vect_cross = rg.Vector3d.CrossProduct(vect_norm, -self._Vects[-1])
                pln = rg.Plane(pt, vect_norm, vect_cross)
                trans = rg.Transform.Mirror(pln)
                vect_reflect = rg.Vector3d(-self._Vects[-1])
                vect_reflect.Transform(trans)
                
                #-/Record this reflection for the next forward/-
                self._Vects.append(vect_reflect)
            
            #-/Record the last forward
            self._Pts.append(pt)
            self._Idcs_face.append(Lst_idx)
        elif self._status == -1:
            #-/The ray get lost in the last forwarding/-
            #-/Terminating the ray with appending the last points/-
            self._Pts.append(pt)
    
    def initiate(self, panel, mesh):
        #-/Initial forward (ray sunlit check)/-
        [pt_hit, Idcs_face] = self.forward(mesh)
        if len(Idcs_face) == 1 and Idcs_face[0] == panel.get_idx():
            self._status = 1 #The ray is initiated
            self.reflect(mesh, pt_hit, Idcs_face)
    
    def cross_air(self, mesh):
        #-/Generate lines from the ray points/-
        for idx in range(len(self._Pts) - 1):
            ln = rg.Line(self._Pts[idx], self._Pts[idx + 1])
            #-/get corresponding portion of the current line/-
            portion = self._portion[idx]
            Idcs = clr.StrongBox[Array[int]]()
            Pts = rg.Intersect.Intersection.MeshLine(mesh, ln, Idcs)
            Lst_idx = list(Idcs.Value)
            for idx_panel in Lst_idx:
                self._sync_air(idx_panel, portion)
    
    #---/Public getters/---
    def is_valid(self):
        if self._status == 1 and self._portion[-1] > 0.1:
            return True
        else:
            return False
    
    def get_tag(self):
        return self._tag
    
    def get_Idcs(self):
        Lst_txt = []
        for Lst_idx in self._Idcs_face:
            Lst_txt_sub = []
            for idx in Lst_idx:
                Lst_txt_sub.append(str(idx))
            txt_sub = '^'.join(Lst_txt_sub)
            Lst_txt.append(txt_sub)
        return Lst_txt
    
    def get_pool(self):
        return self._pool
    
    def get_plc(self): #for test
        if self._Pts and len(self._Pts) > 1:
            plc = rg.PolylineCurve(self._Pts)
            return plc
        else:
            return self._Pts

#----------///The function definitions///----------
def get_sun_pln(mesh, vect):
    """Get the solar angle plane over the target mesh"""
    bbox = mesh.GetBoundingBox(False)
    ptc = bbox.Center
    radius = bbox.Diagonal.Length / 2
    pt = ptc - vect * radius
    pln = rg.Plane(pt, vect)
    return pln

def ray_shoot(ray):
    #-/Normal routine, if not valid, will be passed/-
    count = 0
    while ray.is_valid() and count < 10:
        [pt_hit, Idcs_face] = ray.forward(MESH)
        ray.reflect(MESH, pt_hit, Idcs_face)
        count += 1
    
    #-/Test ray intersect with the airmesh/-
    if scene_air:
        ray.cross_air(MESH_AIR)
    
    #-/Collect log information/-
    txt_tag = ray.get_tag()
    txt_panel = ','.join(ray.get_Idcs())
    txt = txt_tag + '_' + txt_panel
    
    return txt

#----------///Main///----------
def Main(panel):
    if panel.is_sunlit(vect_sun):
        area_lumen = panel.calc_area_lumen(vect_sun)
        Lst_log = []
        Pool_refract = []
        
        #-/The original rays for reflections/-
        Pts = panel.get_Pts()
        idx = panel.get_idx()
        for pt in Pts:
            #-/Declare a new ray/-
            ray = Ray(idx, None, pt, vect_sun, trans_sun, area_lumen, 1.0)
            #-/1st round forward & reflect for sunlit check/-
            ray.initiate(panel, MESH)
            #-/Normal routine/-
            txt = ray_shoot(ray)
            if not txt in Lst_log:
                Lst_log.append(txt)
            Pool_refract.extend(ray.get_pool())
        
        #-/New rays of refractions/-
        for Lst_recipe in Pool_refract:
            #-/Declare a new ray/-
            pt = Lst_recipe[0]
            vect_ray = Lst_recipe[1]
            trans_ray = rg.Transform.Translation(vect_ray * TOL)
            portion = Lst_recipe[2]
            Idcs = Lst_recipe[3]
            ray = Ray(idx, Idcs, pt, vect_ray, trans_ray, area_lumen, portion)
            #-/Normal routine/-
            txt = ray_shoot(ray)
            if not txt in Lst_log:
                Lst_log.append(txt)
        
        #-/Summary/-
        txt_sum = '\n'.join(Lst_log)
    else:
        txt_sum = ''
    return txt_sum

if run_it and recipe:
    #---/Get the system accuracy (normally 0.001)/---
    TOL = sc.doc.ModelAbsoluteTolerance
    
    #---/Get the scenes/---
    scene_solid = Scenes[0]
    if len(Scenes) == 2:
        scene_air = Scenes[1]
    else:
        scene_air = None
    
    #---/Set the sun related inputs/---
    vect_sun = recipe.sunvect
    pln_sun = get_sun_pln(scene_solid.get_mesh(), vect_sun) #Solar plane
    trans_sun = rg.Transform.ProjectAlong(pln_sun, vect_sun)
    
    #---/initialize this run/---
    MESH = scene_solid.get_mesh()
    for panel in scene_solid.get_Panels():
        panel.refresh()
    
    if scene_air:
        MESH_AIR = scene_air.get_mesh()
        for panel in scene_air.get_Panels():
            panel.refresh()
    
    #---/Proceed Ray-Tracing in parallel/---
    Logs = ghpythonlib.parallel.run(Main, scene_solid.get_Panels(), False)
    with open(Paths[0], 'w') as file:
        for txt_log in Logs:
            if txt_log:
                file.write(txt_log)
                file.write('\n')
    
    #---/Extract the energy information of solid panels/---
    Energies_solid = []
    irr_beam = recipe.irr_beam
    irr_diff = recipe.irr_diff
    for panel in scene_solid.get_Panels():
        energy = (irr_beam * panel.get_factor() / panel.size / panel.size + 
                  irr_diff)
        Energies_solid.append(str(energy))
    txt_energy = '\n'.join(Energies_solid)
    with open(Paths[1], 'w') as file:
        file.write(txt_energy)
    
    #---/Extract the energy information of air panels/---
    Energies_air = []
    for panel in scene_air.get_Panels():
        energy = (irr_beam * panel.get_factor() / panel.size / panel.size + 
                  irr_diff)
        Energies_air.append(str(energy))
    txt_energy = '\n'.join(Energies_air)
    with open(Paths[2], 'w') as file:
        file.write(txt_energy)
# ---------- end python_21 ----------

python_22 = GhPythonScript(scene=item.Item1, threshold="3000", path=python_10, Bool=falsestart_5)  # -> Energies, mesh, pack_keep, pack_remove; inputs Bool: Boolean
# ---------- python_22: Python ----------
#----------///The class definitions///----------
class Package:
    #---/Private methods/---
    def __init__(self):
        self._Lst = []
    
    def __repr__(self):
        return 'scene_object<%s>' % str(len(self._Lst))
    
    #---/Public methods/---
    def add(self, num):
        self._Lst.append(num)
    
    def get(self):
        return self._Lst

if path and Bool:
    mesh = scene.get_mesh()
    Energies = []
    pack_keep = Package()
    pack_remove = Package()
    with open(path, 'r') as file:
        for idx, txt in enumerate(file):
            Lst_info = txt.split(';')
            energy = float(Lst_info[0])
            Energies.append(energy)
            if energy >= threshold:
                pack_keep.add(idx)
            else:
                pack_remove.add(idx)
# ---------- end python_22 ----------
heatmap = LBSpatialHeatmap(values=python_9.Energies, mesh=python_9.mesh, legend_par=legendpar, legend_title="Irradiance (W/m2)")  # -> mesh, legend, title, colors, legend_par; plug-in component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
bnd = Bounds(Numbers=python_9.Energies)
falsestart_9 = LBFalseStartToggle(False)
panel_3 = Panel(python_11.Timestamps)
heatmap_2 = LBSpatialHeatmap(values=python_22.Energies, mesh=python_22.mesh, legend_par=legendpar, legend_title="Irradiance (W/m2)")  # -> mesh, legend, title, colors, legend_par; plug-in component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
mesh_7 = Mesh(heatmap.mesh)
lng = ListLength(List=python_11.Timestamps)
python_23 = GhPythonScript(mesh=heatmap.mesh, pack=python_11.pack_remove_new, bool=falsestart_9)  # -> mesh_out; inputs mesh: Mesh, bool: Boolean
# ---------- python_23: Python ----------
__author__ = "ccy"
__version__ = "2022.08.04"

import Rhino.Geometry as rg
import ghpythonlib.components as ghc

if bool:
    mesh_out = mesh.Duplicate()
    mesh_out.Faces.DeleteFaces(pack.get(), True)
# ---------- end python_23 ----------
panel_4 = Panel(lng)
falsestart_10 = LBFalseStartToggle(True)
falsestart_11 = LBFalseStartToggle(False)
falsestart_12 = LBFalseStartToggle(False)  # disabled
python_24 = GhPythonScript(mesh=heatmap_2.mesh, pack=python_22.pack_remove, bool=falsestart_10)  # -> mesh_out; inputs mesh: Mesh, bool: Boolean; same code as python_23
python_25 = GhPythonScript(scene=item.Item, archive=python_11.archive, pack_self=python_11.pack_keep_new, run_it=falsestart_11)  # -> pack_remove; inputs run_it: Boolean
# ---------- python_25: Python ----------
import os
import Rhino.RhinoDoc as rrd
import ghpythonlib.parallel

#----------///The class definitions///----------
class Package:
    #---/Private methods/---
    def __init__(self):
        self._Lst = []
    
    def __repr__(self):
        return 'scene_object<%s>' % str(len(self._Lst))
    
    #---/Public methods/---
    def add(self, num):
        self._Lst.append(num)
    
    def get(self):
        return self._Lst



#----------///The function definitions///----------
def del_dict(timestamp):
    path = folder + 'Log_' + timestamp + '.txt'
    Lst_idx = archive.get_Idcs(timestamp)
    with open(path, 'r') as file:
        txt_raw = file.read()
    Lst_txt = txt_raw.split('\n')
    txt = Lst_txt[13287]
    Lst_remove = _get_beginner(txt, Lst_idx)
    for txt in Lst_txt:
        Lst_remove = _get_beginner(txt, Lst_idx)
        for idx in Lst_remove:
            _DICT_[idx] = 0

def _get_beginner(txt, Lst_ref): #Trace all reflection meshes
    valid = False
    Lst_all = txt.split('_')
    tag = Lst_all[0]
    txt_panel = Lst_all[-1]
    try:
        Lst_idx = txt_panel.split(',')
        if tag == 'I':
            idx_first = int(Lst_all[1])
            Lst_out = [idx_first]
        else:
            Lst_out = []
        for txt_idx in Lst_idx:
            idx_pass = int(txt_idx)
            Lst_out.append(idx_pass)
            if idx_pass in Lst_ref:
                valid = True
                break
    except:
        pass
    if valid:
        return Lst_out
    else:
        return []
    return Lst_out

if run_it:
    #-/Get the file path/-
    path_3dm = rrd.ActiveDoc.Path
    folder = os.path.dirname(os.path.abspath(path_3dm))
    folder += "\\Logs\\"
    
    #-/Initiate the dictionary/-
    _DICT_ = {}
    for i in range(len(scene.get_Panels())):
        _DICT_[i] = 1
    
    #-/Iterate the entire year/-
    Timestamps = archive.get_times()
    ghpythonlib.parallel.run(del_dict, Timestamps, False)
    
        #-/Remove self/-
    for idx_self in pack_self.get():
        _DICT_[idx_self] = 1
    
    #-/Collect indices to remove from mesh/-
    pack_remove = Package()
    for idx in _DICT_.keys():
        if _DICT_[idx] > 0:
            pack_remove.add(int(idx))
# ---------- end python_25 ----------
python_26 = GhPythonScript(scene=item.Item, archive=python_11.archive, pack_self=python_11.pack_keep_new, run_it=falsestart_12)  # -> pack_remove; inputs run_it: Boolean; disabled
# ---------- python_26: Python ----------
import os
import Rhino.RhinoDoc as rrd
import ghpythonlib.parallel

#----------///The class definitions///----------
class Package:
    #---/Private methods/---
    def __init__(self):
        self._Lst = []
    
    def __repr__(self):
        return 'scene_object<%s>' % str(len(self._Lst))
    
    #---/Public methods/---
    def add(self, num):
        self._Lst.append(num)
    
    def get(self):
        return self._Lst



#----------///The function definitions///----------
def del_dict(timestamp):
    path = folder + 'Log_' + timestamp + '.txt'
    Lst_idx = archive.get_Idcs(timestamp)
    with open(path, 'r') as file:
        txt_raw = file.read()
    Lst_txt = txt_raw.split('\n')
    for txt in Lst_txt:
        idx_remove = _get_beginner(txt, Lst_idx)
        _DICT_[idx_remove] = 0

def _get_beginner(txt, Lst_ref): #Only trace the initial reflection mesh
    idx_out = None
    Lst_all = txt.split('_')
    txt_panel = Lst_all[-1]
    try:
        Lst_idx = txt_panel.split(',')
        for txt_idx in Lst_idx:
            idx_pass = int(txt_idx)
            if idx_pass in Lst_ref:
                idx_out = int(Lst_all[1])
                break
    except:
        pass
    return idx_out

if run_it:
    #-/Get the file path/-
    path_3dm = rrd.ActiveDoc.Path
    folder = os.path.dirname(os.path.abspath(path_3dm))
    folder += "\\Logs\\"
    
    #-/Initiate the dictionary/-
    _DICT_ = {}
    for i in range(len(scene.get_Panels())):
        _DICT_[i] = 1
    
    #-/Iterate the entire year/-
    Timestamps = archive.get_times()
    ghpythonlib.parallel.run(del_dict, Timestamps, False)
    
        #-/Remove self/-
    for idx_self in pack_self.get():
        _DICT_[idx_self] = 1
    
    #-/Collect indices to remove from mesh/-
    pack_remove = Package()
    for idx in _DICT_.keys():
        if _DICT_[idx] > 0:
            pack_remove.add(int(idx))
# ---------- end python_26 ----------
falsestart_13 = LBFalseStartToggle(False)
item_2 = ListItem(List=python_11.Timestamps, Index=Slider(1, range=0..36), Wrap=True)
falsestart_14 = LBFalseStartToggle(False)
python_27 = GhPythonScript(Recipes=ashrae_sunpath.Recipes, timestamp=item_2, run_it=falsestart_13)  # -> recipe, path_log, path_result; inputs Recipes: list, run_it: Boolean
# ---------- python_27: Python ----------
import os
import Rhino.RhinoDoc as rrd
import ghpythonlib.parallel

#----------///The class definitions///----------
class Package:
    #---/Private methods/---
    def __init__(self):
        self._Lst = []
    
    def __repr__(self):
        return 'scene_object<%s>' % str(len(self._Lst))
    
    #---/Public methods/---
    def add(self, num):
        self._Lst.append(num)
    
    def get(self):
        return self._Lst

#----------///The function definitions///----------
def get_beginner(txt):
    idx_first = None
    txt_panel = txt.split('_')[-1]
    try:
        Lst_idx = txt_panel.split(',')
        for txt_idx in Lst_idx:
            idx_pass = int(txt_idx)
            if idx_pass in Idcs_panel:
                idx_first = int(Lst_idx[0])
                break
    except:
        pass
    return idx_first

if run_it:
    #-/Get the target receipe/-
    for recipe in Recipes:
        timestamp_test = recipe.timestamp
        if timestamp_test == timestamp:
            break
    
    #-/Get the file path/-
    #---///Prepare the folder path part///---
    path_3dm = rrd.ActiveDoc.Path
    folder = os.path.dirname(os.path.abspath(path_3dm))
    folder1 = folder + "\\Logs\\"
    folder2 = folder + "\\Results\\"
    path_log = folder1 + 'Log_' + timestamp + '.txt'
    path_result = folder2 + 'Result_' + timestamp + '.txt'
# ---------- end python_27 ----------
panel_5 = Panel(item_2)
python_28 = GhPythonScript(mesh=python_9.mesh, pack=python_25, bool=falsestart_14)  # -> mesh_out; inputs mesh: Mesh, bool: Boolean; same code as python_23
falsestart_15 = LBFalseStartToggle(False)
mcol_2 = MeshColours(Mesh=python_28, Colours=ColourSwatch(SwatchColor=RGB(255, 0, 0)))
colrange_2 = LBColorRange(index="3")  # -> colors; plug-in component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
line = Line(Line((-11.60643538, -33.8299659, 0), (-11.85643538, -34.0799659, 0)))
falsestart_16 = LBFalseStartToggle(False)
midpt = CurveMiddle(Curve=line)
python_29 = GhPythonScript(
    scene=item.Item,
    pack_keep=python_11.pack_keep_new,
    pack_remove=python_11.pack_remove_new,
    threshold="2500",
    path=python_27.path_result,
    Bool=falsestart_15)  # -> Energies, mesh, pack_keep_new, pack_remove_new; inputs Bool: Boolean
# ---------- python_29: Python ----------
#----------///The class definitions///----------
class Package:
    #---/Private methods/---
    def __init__(self):
        self._Lst = []
    
    def __repr__(self):
        return 'scene_object<%s>' % str(len(self._Lst))
    
    #---/Public methods/---
    def add(self, num):
        self._Lst.append(num)
    
    def get(self):
        return self._Lst

if path and Bool:
    mesh = scene.get_mesh()
    Energies = []
    pack_keep_new = Package()
    pack_remove_new = Package()
    with open(path, 'r') as file:
        for idx, txt in enumerate(file):
            Lst_info = txt.split(';')
            energy = float(Lst_info[0])
            Energies.append(energy)
            if energy >= threshold and idx in pack_keep.get():
                pack_keep_new.add(idx)
            else:
                pack_remove_new.add(idx)
# ---------- end python_29 ----------
legendpar_2 = LBLegendParameters(min="0", max="2500", seg_count="11", colors=colrange_2, continuous_leg=Toggle(True))  # -> leg_par; plug-in component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
python_30 = GhPythonScript(scene=item.Item, pt=midpt, radius="0.05", run_it=falsestart_16)  # -> sphere, Idcs_panel; inputs pt: Point3d, run_it: Boolean
# ---------- python_30: Python ----------
__author__ = "ccy"
__version__ = "2022.11.07"

import Rhino.Geometry as rg

#----------///The function definitions///----------
def get_tree(mesh):
    tree = rg.RTree()
    for idx in range(mesh.Faces.Count):
        pt= mesh.PointAt(idx, 0.5, 0, 0.5, 0)
        tree.Insert(pt, idx)
    return tree

def SearchCallback(sender, e):
        Idcs_panel.append(e.Id)

if run_it:
    #-/Get the target face indices/-
    mesh = scene.get_mesh()
    tree = get_tree(mesh)
    sphere = rg.Sphere(pt, radius)
    Idcs_panel = []
    tree.Search(sphere, SearchCallback, Idcs_panel)
# ---------- end python_30 ----------
heatmap_3 = LBSpatialHeatmap(values=python_29.Energies, mesh=python_29.mesh, legend_par=legendpar_2)  # -> mesh, legend, title, colors, legend_par; plug-in component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
brep = Brep(python_30.sphere)
falsestart_17 = LBFalseStartToggle(False)
python_31 = GhPythonScript(path=python_27.path_log, Idcs_panel=python_30.Idcs_panel, run_it=falsestart_16)  # -> Idcs_shoot; inputs Idcs_panel: list of Int32, run_it: Boolean
# ---------- python_31: Python ----------
import os
import Rhino.RhinoDoc as rrd
import ghpythonlib.parallel

#----------///The function definitions///----------
def get_beginner(txt):
    idx_out = None
    Lst_all = txt.split('_')
    txt_panel = Lst_all[-1]
    try:
        Lst_idx = txt_panel.split(',')
        for txt_idx in Lst_idx:
            idx_pass = int(txt_idx)
            if idx_pass in Idcs_panel:
                idx_out = int(Lst_all[1])
                break
    except:
        pass
    return idx_out

if run_it:
    #-/Get the log information of the targets/-
    with open(path, 'r') as file:
        Lst_txt = file.readlines()
    Idcs_raw = ghpythonlib.parallel.run(get_beginner, Lst_txt, False)
    Idcs_shoot = []
    for idx_raw in Idcs_raw:
        if idx_raw and not idx_raw in Idcs_shoot:
            Idcs_shoot.append(idx_raw)
# ---------- end python_31 ----------
python_32 = GhPythonScript(mesh=heatmap_3.mesh, pack=python_29.pack_remove_new, bool=falsestart_17)  # -> mesh_out; inputs mesh: Mesh, bool: Boolean; same code as python_23
mesh_8 = Mesh(heatmap_3.mesh)
python_33 = GhPythonScript(recipe=python_27.recipe, scene=item.Item, Idcs_termin=python_30.Idcs_panel, Idcs_shoot=python_31, run_it=falsestart_16)  # -> out, Rays, Checks; inputs Idcs_termin: list of Int32, Idcs_shoot: list of Int32, run_it: Boolean
# ---------- python_33: Python ----------
import Rhino.Geometry as rg
import scriptcontext as sc
from System import Array
import clr
import ghpythonlib.parallel

#----------///The class definitions///----------
class Ray:
    #---/Private methods/---
    def __init__(self, idx_panel1, Idcs_panel2,
                 pt_in, vect, trans, area, portion):
        pt = rg.Point3d(pt_in)
        pt.Transform(trans)
        self._Pts = [pt]
        self._Vects = [vect]
        self._area = area
        self._portion = [portion]
        if Idcs_panel2:
            self._status = 1 #The ray is already initiated
            self._tag = 'I_' + str(idx_panel1)
            self._Idcs_face = [Idcs_panel2]
        else:
            self._status = 0 #The ray is waiting to be initiated
            self._tag = 'O_' + str(idx_panel1)
            self._Idcs_face = []
        self._pool = []
    
    #---/Private function methods/---
    def _sync_panel(self, Lst, vect_ray):
        #-/Read information from the scene archive by indices/-
        valid = False
        vect = rg.Vector3d.Zero
        Lst_tag = []
        factor = self._portion[-1] * self._area
        for idx in Lst:
            panel = scene.get_panel(idx)
            vect_panel = panel.get_norm()
            if vect_panel * vect_ray < 0:
                valid = True
                panel.add_factor(factor)
                vect += panel.get_norm()
                tag = panel.get_tag()
                if not tag in Lst_tag:
                    Lst_tag.append(tag)
        if valid:
            vect.Unitize()
            tag = Lst_tag[0]
            return vect, tag
        else:
            #-/Turn to the terminating routine/-
            self._status = -1 #Ray get lost
            return None, None
    
    #---/Public function methods/---
    def forward(self, mesh):
        #-/Prepare the basic forward recipe/-
        adjust = TOL
        Idcs = clr.StrongBox[Array[int]]()
        Lst_idx = []
        pt = self._Pts[-1]
        vect = self._Vects[-1]
        pt_start = pt + vect * adjust
        
        #-/Initial forward to see if missed anything/-
        ray = rg.Ray3d(pt_start, -vect)
        dist = rg.Intersect.Intersection.MeshRay(mesh, ray, Idcs)
        Lst_check = list(Idcs.Value)
        if (dist > 0 and dist < vect.Length * adjust and
                       Lst_check != self._Idcs_face[-1]):
            #-/Really missed something/-
            pt_new = pt_start - vect * dist
            Lst_idx.extend(Lst_check)
        else:
            #-/Not missing anything/-
            ray = rg.Ray3d(pt_start, vect)
            dist = rg.Intersect.Intersection.MeshRay(mesh, ray, Idcs)
            if dist > 0:
                pt_new = pt_start + vect * dist
                Lst_idx.extend(list(Idcs.Value))
            else:
                #-/Turn to the terminating routine/-
                self._status = -1 #Ray get lost
                dist = 20
                pt_new = pt_start + vect * dist
        return pt_new, Lst_idx
    
    def reflect(self, mesh, pt, Lst_idx):
        if self._status == 1 or self._status == 0:
            #-/The ray is on going or is waiting to be initiated/-
            #-/Attract information from the panels/-
            [vect_norm, tag] = self._sync_panel(Lst_idx, self._Vects[-1])
            
            if self.is_valid():
                #-/Calculate the incident angle/-
                pln = rg.Plane(pt, vect_norm, -self._Vects[-1])
                rad = rg.Vector3d.VectorAngle(vect_norm, -self._Vects[-1], pln)
                [reflect, refract] = scene.calc_reflection(tag, rad)
                
                #-/Prepare recipe for new refract ray/-
                if refract:
                    self._pool.append([pt, self._Vects[-1],
                                       self._portion[-1] * refract,
                                       Lst_idx])
                #-/Continue reflecting/-
                self._portion.append(self._portion[-1] * reflect)
            if self.is_valid():
                #-/Reflection/-
                vect_cross = rg.Vector3d.CrossProduct(vect_norm, -self._Vects[-1])
                pln = rg.Plane(pt, vect_norm, vect_cross)
                trans = rg.Transform.Mirror(pln)
                vect_reflect = rg.Vector3d(-self._Vects[-1])
                vect_reflect.Transform(trans)
                
                #-/Record this reflection for the next forward/-
                self._Vects.append(vect_reflect)
            
            #-/Record the last forward
            self._Pts.append(pt)
            self._Idcs_face.append(Lst_idx)
        elif self._status == -1:
            #-/The ray get lost in the last forwarding/-
            #-/Terminating the ray with appending the last points/-
            self._Pts.append(pt)
    
    def initiate(self, panel, mesh):
        #-/Initial forward (ray sunlit check)/-
        [pt_hit, Idcs_face] = self.forward(mesh)
        if len(Idcs_face) == 1 and Idcs_face[0] == panel.get_idx():
            self._status = 1 #The ray is initiated
            self.reflect(mesh, pt_hit, Idcs_face)
    
    #---/Public getters/---
    def is_valid(self):
        if self._status == 1 and self._portion[-1] > 0.1:
            return True
        else:
            return False
    
    def get_idx(self):
        try:
            Lst_idx = []
            for Lst_temp in self._Idcs_face:
                Lst_idx.extend(Lst_temp)
            return Lst_idx
        except:
            return []
    
    def get_pool(self):
        return self._pool
    
    def get_plc(self): #for test
        if self._Pts and len(self._Pts) > 1:
            plc = rg.PolylineCurve(self._Pts)
            return plc
        else:
            return self._Pts

#----------///The function definitions///----------
def get_sun_pln(mesh, vect):
    """Get the solar angle plane over the target mesh"""
    bbox = mesh.GetBoundingBox(False)
    ptc = bbox.Center
    radius = bbox.Diagonal.Length / 2
    pt = ptc - vect * radius
    pln = rg.Plane(pt, vect)
    return pln

def ray_shoot(ray):
    #-/Normal routine, if not valid, will be passed/-
    count = 0
    while ray.is_valid() and count < 10:
        [pt_hit, Idcs_face] = ray.forward(MESH)
        ray.reflect(MESH, pt_hit, Idcs_face)
        count += 1

def add_to_dict(dict, key, area, portion):
    if key in dict.keys():
        dict[key]['count'] += 1
    else:
        dict[key] = {'count': 1, 'area': area, 'portion': portion}
    return dict

#----------///Main///----------
def Main(panel):
    if panel.is_sunlit(vect_sun):
        area_lumen = panel.calc_area_lumen(vect_sun)
        Rays = []
        Rays_save = []
        Pool_refract = []
        
        #-/The original rays for reflections/-
        Pts = panel.get_Pts()
        idx = panel.get_idx()
        for pt in Pts:
            #-/Declare a new ray/-
            ray = Ray(idx, None, pt, vect_sun, trans_sun, area_lumen, 1.0)
            #-/1st round forward & reflect for sunlit check/-
            ray.initiate(panel, MESH)
            #-/Normal routine/-
            ray_shoot(ray)
            Pool_refract.extend(ray.get_pool())
            Rays_save.append(ray.get_plc())
            Checks.append(ray.get_plc())
            Lst_check = ray.get_idx()
            for idx_check in Lst_check:
                if idx_check in Idcs_termin:
                    Rays.append(ray.get_plc())
                    break
        
        #-/New rays of refractions/-
        for idx_ray, Lst_recipe in enumerate(Pool_refract):
            #-/Declare a new ray/-
            pt = Lst_recipe[0]
            vect_ray = Lst_recipe[1]
            trans_ray = rg.Transform.Translation(vect_ray * TOL)
            portion = Lst_recipe[2]
            Idcs = Lst_recipe[3]
            ray = Ray(idx, Idcs, pt, vect_ray, trans_ray, area_lumen, portion)
            #-/Normal routine/-
            ray_shoot(ray)
            Checks.append(ray.get_plc())
            Lst_check = ray.get_idx()
            for idx_check in Lst_check:
                if idx_check in Idcs_termin:
                    Rays.append(ray.get_plc())
                    Rays.append(Rays_save[idx_ray])
                    break
    else:
        Rays = None
    return Rays

if run_it:
    #---/Get the system accuracy (normally 0.001)/---
    TOL = sc.doc.ModelAbsoluteTolerance
    Checks = []
    
    #---/Set the sun related inputs/---
    vect_sun = recipe.sunvect
    pln_sun = get_sun_pln(scene.get_mesh(), vect_sun) #Solar plane
    trans_sun = rg.Transform.ProjectAlong(pln_sun, vect_sun)
    
    #---/initialize this run/---
    MESH = scene.get_mesh()
    for panel in scene.get_Panels():
        panel.refresh()
    Panels = []
    for idx_panel in Idcs_shoot:
        panel = scene.get_panel(idx_panel)
        Panels.append(panel)
    
    #---/Proceed Ray-Tracing in parallel/---
    Rays = ghpythonlib.parallel.run(Main, Panels, True)
# ---------- end python_33 ----------
python_34 = GhPythonScript(Plcs=python_33.Rays)  # -> Plcs_in, Plcs_out; inputs Plcs: list of Polyline
# ---------- python_34: Python ----------
__author__ = "ccy"
__version__ = "2022.12.13"

import Rhino.Geometry as rg

Plcs_in = []
Plcs_out = []

for plc in Plcs:
    Pts = []
    Pts.extend(plc)
    Pts1 = Pts[:2]
    plc1 = rg.PolylineCurve(Pts1)
    Plcs_in.append(plc1)
    Pts2 = Pts[1:]
    plc2 = rg.PolylineCurve(Pts2)
    Plcs_out.append(plc2)
# ---------- end python_34 ----------
material = CreateMaterial(
    Diffuse=ColourSwatch(SwatchColor=RGB(255, 157, 0)),
    Specular=RGB(255, 255, 255),
    Emission=RGB(0, 0, 0),
    Transparency=0,
    Shine=0)
material_2 = CreateMaterial(
    Diffuse=ColourSwatch(SwatchColor=RGB(255, 219, 128)),
    Specular=RGB(255, 255, 255),
    Emission=RGB(0, 0, 0),
    Transparency=0,
    Shine=0)
preview = CustomPreview(Geometry=python_34.Plcs_out, Material=material_2)
preview_2 = CustomPreview(Geometry=python_34.Plcs_in, Material=material)
